# Grasshopper definition AHU_acoustic_lighting_Planner.gh (Grasshopper 1.0.7)

# Window design I
toggle = BooleanToggle(False)

# ---- group: Fenstertyp II / Oberlicht
# O
# P
# T
#  I
# O
# N
# A
# L
# 
#  I
# N
# P
# U
# T
# Fenstertyp II/ Oberlicht
breite = Slider(2.28, range=0.8..2.4)
höhe = Slider(0.54, range=0.4..3)
fenstersims_höhe = Slider(2.4, range=0..7.28)
anzahl_fenster = Slider(0, range=0..10)
abstand_zum_ersten_fenster = Slider(0.4, range=0..1)
# Befindest sich die Fensterseite auf
# der linken  Seite der Tafel?
# False = Nein, True = Ja
abstand_zwischen_fenstern = Slider(0.16, range=0..1)

# ---- group: Raumausrichtung
befindet_sich_die_fensterseite_auf_der_l = BooleanToggle(False)  # "Befindet sich die Fensterseite auf der linken Seite der Tafel?"
# Ist die Rückwand eine Außenwand?
# False = nein, True = ja.
ist_die_rückwand_eine_außenwand = BooleanToggle(False)

# ---- group: Fenster
# Fenstertyp I
breite_2 = Slider(2.35, range=0.8..4.47)
fenstersims_höhe_2 = Slider(0.78, range=0.6..1)
# Window design 2
abstand_zwischen_fenstern_2 = Slider(0.67, range=0..1)
höhe_2 = Slider(2.02, range=1.2..2.5)
abstand_wand_zum_ersten_fenster = Slider(0.4, range=0..4)
anzahl_fenster_2 = Slider(3, range=0..10)

# ---- group: Klassenzimmergröße / Rauminnenmaße
# Classroom dimensions
# Klassenzimmergröße/ Rauminnenmaße
länge = Slider(10.25, range=7..15)
# Befindet sich bereits
# eine abgehängte Decke
# im Raum, die nicht
# zurückgebaut werden soll?
# False = Nein, True = Ja
lichte_höhe = Slider(3.3, range=2.5..3.5)
breite_3 = Slider(6.75, range=5..8)

# ---- group: Fensterunterteilung
# Subdivision of window frame
# Fensterunterteilung
unterteilungen = Slider(2, range=0..11)
breite_erste_unterteilung = Slider(1.1, range=0.5..2)
breite_zweite_unterteilung = Slider(0.45, range=0.1..2)
# Subdivision of window frame
# Fensterunterteilung
rahmenbreite_außenrahmen = Slider(0.07, range=0.03..0.15)

# ---- group: Fensterunterteilung Oberlichter
unterteilungen_2 = Slider(0, range=0..11)
breite_zweite_unterteilung_2 = Slider(0.45, range=0.1..2)
breite_erste_unterteilung_2 = Slider(1.1, range=0.8..2.4)
rahmenbreite_außenrahmen_2 = Slider(0.07, range=0.03..0.15)

# ---- group: Deckenraster
# Ceiling grid
# Deckenraster
länge_2 = Slider(0.625, range=0..4)
breite_4 = Slider(0.625, range=0.15..2.2)
abhaengtiefe = Slider(0.41, range=0.05..0.8, expression="x*(-1)")

# ----
subtraction = Subtraction(A=höhe, B=rahmenbreite_außenrahmen_2)
subtraction_2 = Subtraction(A=unterteilungen_2, B=1)
subtraction_3 = Subtraction(A=breite, B=rahmenbreite_außenrahmen_2)
X = UnitX(Factor=abstand_wand_zum_ersten_fenster)
addition = Addition(A=breite_2, B=abstand_zwischen_fenstern_2)
addition_2 = Addition(A=breite_2, B=abstand_zwischen_fenstern)
Z = UnitZ(Factor=fenstersims_höhe)
subtraction_4 = Subtraction(A=höhe_2, B=rahmenbreite_außenrahmen)
subtraction_5 = Subtraction(A=unterteilungen, B=1)
subtraction_6 = Subtraction(A=breite_2, B=rahmenbreite_außenrahmen)
swatch = ColourSwatch(SwatchColor=RGBA(148, 148, 148, 94))
panel = Panel("Tafel")
Z_2 = UnitZ(Factor=-0.41)
Z_3 = UnitZ(Factor=-0.41)

Y = UnitY(Factor=0.25)

X_2 = UnitX(Factor=0.51)
Y_2 = UnitY(Factor=0.25)
Y_3 = UnitY(Factor=-0.4)
Y_4 = UnitY(Factor=-0.25)
Z_4 = UnitZ(Factor=0.2)

Y_5 = UnitY(Factor=-0.55)
Y_6 = UnitY(Factor=-0.55)
Y_7 = UnitY(Factor=-0.55)
Y_8 = UnitY(Factor=-0.55)
X_3 = UnitX(Factor=-0.27)
X_4 = UnitX(Factor=-0.27)
X_5 = UnitX(Factor=-0.27)
X_6 = UnitX(Factor=-0.27)
Y_9 = UnitY(Factor=0.25)
X_7 = UnitX(Factor=-1.8)
X_8 = UnitX(Factor=-1.8)
Y_10 = UnitY(Factor=-0.4)

xy = XYPlane(Origin=Point(0, 0, 0))
dom = ConstructDomain(DomainStart=0, DomainEnd=länge)
dom_2 = ConstructDomain(DomainStart=0, DomainEnd=breite_3)
rectangle = Rectangle(Plane=xy, XSize=dom, YSize=dom_2, Radius=0)  # -> Rectangle, Length
boundary = BoundarySurfaces(Edges=rectangle.Rectangle)
Z_5 = UnitZ(Factor=lichte_höhe)
extr = Extrude(Base=boundary, Direction=Z_5)

debrep = DeconstructBrep(Brep=extr)  # -> Faces, Edges, Vertices

item = ListItem(List=debrep.Edges, Index=Slider(0, range=0..11), Wrap=True)
end = EndPoints(Curve=item)  # -> Start, End
dom_3 = ConstructDomain(DomainStart=end.End, DomainEnd=breite)
dom_4 = ConstructDomain(DomainStart=end.End, DomainEnd=rahmenbreite_außenrahmen_2)
dom_5 = ConstructDomain(DomainStart=-0.02, DomainEnd=0.02)
rectangle_2 = Rectangle(Plane=end.End, XSize=dom_4, YSize=dom_5, Radius=0)  # -> Rectangle, Length
rectangle_3 = Rectangle(Plane=end.End, XSize=dom_3, YSize=dom_5, Radius=0)  # -> Rectangle, Length
Z_6 = UnitZ(Factor=rahmenbreite_außenrahmen_2)
boundary_2 = BoundarySurfaces(Edges=rectangle_3.Rectangle)
boundary_3 = BoundarySurfaces(Edges=rectangle_2.Rectangle)
Z_7 = UnitZ(Factor=höhe)
extr_2 = Extrude(Base=boundary_2, Direction=Z_6)
extr_3 = Extrude(Base=boundary_3, Direction=Z_7)
series = Series(Start=0, Step=0, Count=subtraction_2)
X_9 = UnitX(Factor=series)
move = Move(Geometry=extr_3, Motion=X_9)  # -> Geometry, Transform
addition_3 = Addition(A=breite_erste_unterteilung_2, B=breite_zweite_unterteilung_2)
item_2 = ListItem(List=move.Geometry, Index=0, Wrap=False)
item_3 = ListItem(List=move.Geometry, Index=1, Wrap=False)
X_10 = UnitX(Factor=breite_erste_unterteilung_2)
X_11 = UnitX(Factor=addition_3)
X_12 = UnitX(Factor=subtraction_3)
Z_8 = UnitZ(Factor=subtraction)
move_2 = Move(Geometry=extr_2, Motion=Z_8)  # -> Geometry, Transform
move_3 = Move(Geometry=extr_3, Motion=X_12)  # -> Geometry, Transform
move_4 = Move(Geometry=item_2, Motion=X_10)  # -> Geometry, Transform
move_5 = Move(Geometry=item_3, Motion=X_11)  # -> Geometry, Transform
sdiff = SolidDifference(BrepsA=[extr_3, move_3.Geometry, move_4.Geometry, move_5.Geometry], BrepsB=[extr_2, move_2.Geometry])
sunion = SolidUnion(Breps=[extr_2, sdiff, move_2.Geometry])
X_13 = UnitX(Factor=abstand_zum_ersten_fenster)
move_6 = Move(Geometry=sunion, Motion=X_13)  # -> Geometry, Transform
series_2 = Series(Start=0, Step=addition_2, Count=anzahl_fenster)
X_14 = UnitX(Factor=series_2)
move_7 = Move(Geometry=move_6.Geometry, Motion=X_14)  # -> Geometry, Transform
move_8 = Move(Geometry=graft(move_7.Geometry), Motion=Z)  # -> Geometry, Transform
preview = CustomPreview(Geometry=move_8.Geometry, Shader=ColourSwatch(SwatchColor=RGBA(128, 128, 128, 244)))

item_4 = ListItem(List=debrep.Edges, Index=Slider(0, range=0..11), Wrap=True)
debrep_2 = DeconstructBrep(Brep=extr)  # -> Faces, Edges, Vertices
item_5 = ListItem(List=debrep_2.Faces, Index=Slider(1, range=0..11), Wrap=True)

item_6 = ListItem(List=debrep.Faces, Index=Slider(4, range=0..11), Wrap=True)
area = Area(Geometry=item_6)  # -> Area, Centroid
yz = YZPlane(Origin=area.Centroid)
rectangle_4 = Rectangle(Plane=yz, XSize=Domain(-1.2, 1.2), YSize=Domain(-0.5, 0.6), Radius=0)  # -> Rectangle, Length
boundary_4 = BoundarySurfaces(Edges=rectangle_4.Rectangle)
X_15 = UnitX(Factor=0.03)
extr_4 = Extrude(Base=boundary_4, Direction=X_15)
preview_2 = CustomPreview(Geometry=extr_4, Shader=ColourSwatch(SwatchColor=RGBA(70, 127, 64, 105)))

# ----
# AHU
# AHU Dimensions
number_slider = Slider(1, range=0..3)
Z_9 = UnitZ(Factor=abhaengtiefe)

X_16 = UnitX(Factor=0.24)
item_7 = ListItem(List=debrep.Faces, Index=Slider(1, range=0..11), Wrap=True)
Y_11 = UnitY(Factor=-0.75)
Z_10 = UnitZ(Factor=0.2)

item_8 = ListItem(List=debrep.Edges, Index=Slider(2, range=0..11), Wrap=True)
divide = DivideCurve(Curve=item_8, Count=anzahl_fenster_2, Kinks=True)  # -> Points, Tangents, Parameters
shatter = Shatter(Curve=item_8, Parameters=divide.Parameters)
curvepoint = PointOnCurve(shatter, parameter=0.5)
Z_11 = UnitZ(Factor=fenstersims_höhe_2)
move_9 = Move(Geometry=curvepoint, Motion=Z_11)  # -> Geometry, Transform
Z_12 = UnitZ(Factor=höhe_2)
series_3 = Series(Start=0, Step=addition, Count=anzahl_fenster_2)
X_17 = UnitX(Factor=series_3)
Z_13 = UnitZ(Factor=fenstersims_höhe_2)
preview_3 = CustomPreview(Geometry=item_5, Shader=ColourSwatch(SwatchColor=RGBA(148, 148, 148, 105)))

number_slider_2 = Slider(1, range=0..11)
python = GhPythonScript(x=befindet_sich_die_fensterseite_auf_der_l)  # -> out, a, b, c
# ---------- python: Python ----------
__author__ = "lorenz"
__version__ = "2023.06.29"

import rhinoscriptsyntax as rs

if x == 0:
    a = 0
    b = 0
    c = 'string'

elif x == 1:
    a = 1
    b = 'string'
    c = 0
# ---------- end python ----------
item_9 = ListItem(List=debrep.Edges, Index=python.a, Wrap=True)
curvepoint_2 = PointOnCurve(item_9, parameter=0.5)
xz = XZPlane(Origin=curvepoint_2)

X_18 = UnitX(Factor=python.c)

item_10 = ListItem(List=debrep.Faces, Index=Slider(0, range=0..11), Wrap=True)
item_11 = ListItem(List=debrep.Faces, Index=Slider(1, range=0..11), Wrap=True)

item_12 = ListItem(List=debrep.Faces, Index=Slider(0, range=0..11), Wrap=True)
item_13 = ListItem(List=debrep.Edges, Index=Slider(5, range=0..11), Wrap=True)
item_14 = ListItem(List=debrep.Faces, Index=Slider(1, range=0..11), Wrap=True)

X_19 = UnitX(Factor=0.51)
item_15 = ListItem(List=debrep.Faces, Index=Slider(1, range=0..11), Wrap=True)
Y_12 = UnitY(Factor=-0.4)
Z_14 = UnitZ(Factor=0.2)

Y_13 = UnitY(Factor=-0.55)
X_20 = UnitX(Factor=-0.27)

item_16 = ListItem(List=debrep.Edges, Index=Slider(6, range=0..11), Wrap=True)

dom_6 = ConstructDomain(DomainStart=-0.01, DomainEnd=0.01)
Z_15 = UnitZ(Factor=höhe)
X_21 = UnitX(Factor=abstand_zum_ersten_fenster)
addition_4 = Addition(A=breite, B=abstand_zwischen_fenstern)
series_4 = Series(Start=0, Step=addition_4, Count=anzahl_fenster)
X_22 = UnitX(Factor=series_4)
Z_16 = UnitZ(Factor=fenstersims_höhe)

X_23 = UnitX(Factor=0.51)
item_17 = ListItem(List=debrep.Faces, Index=Slider(1, range=0..11), Wrap=True)
Y_14 = UnitY(Factor=-0.4)
Z_17 = UnitZ(Factor=0.2)

X_24 = UnitX(Factor=python.b)

Y_15 = UnitY(Factor=-0.55)
Y_16 = UnitY(Factor=-0.55)
Y_17 = UnitY(Factor=-0.55)
Y_18 = UnitY(Factor=-0.55)
X_25 = UnitX(Factor=-0.27)
X_26 = UnitX(Factor=-0.27)
X_27 = UnitX(Factor=-0.27)
X_28 = UnitX(Factor=-0.27)
Y_19 = UnitY(Factor=0.25)
X_29 = UnitX(Factor=-1.8)

end_2 = EndPoints(Curve=item_4)  # -> Start, End
dom_7 = ConstructDomain(DomainStart=end_2.End, DomainEnd=breite_2)
dom_8 = ConstructDomain(DomainStart=end_2.End, DomainEnd=rahmenbreite_außenrahmen)
rectangle_5 = Rectangle(Plane=end_2.End, XSize=dom_7, YSize=Domain(-0.02, 0.02), Radius=0)  # -> Rectangle, Length
rectangle_6 = Rectangle(Plane=end_2.End, XSize=dom_8, YSize=Domain(-0.02, 0.02), Radius=0)  # -> Rectangle, Length
Z_18 = UnitZ(Factor=rahmenbreite_außenrahmen)
boundary_5 = BoundarySurfaces(Edges=rectangle_5.Rectangle)
boundary_6 = BoundarySurfaces(Edges=rectangle_6.Rectangle)
Z_19 = UnitZ(Factor=höhe_2)
extr_5 = Extrude(Base=boundary_5, Direction=Z_18)
extr_6 = Extrude(Base=boundary_6, Direction=Z_19)
series_5 = Series(Start=0, Step=0, Count=subtraction_5)
X_30 = UnitX(Factor=series_5)
move_10 = Move(Geometry=extr_6, Motion=X_30)  # -> Geometry, Transform
addition_5 = Addition(A=breite_erste_unterteilung, B=breite_zweite_unterteilung)
Z_20 = UnitZ(Factor=subtraction_4)
item_18 = ListItem(List=move_10.Geometry, Index=0, Wrap=False)
item_19 = ListItem(List=move_10.Geometry, Index=1, Wrap=False)
X_31 = UnitX(Factor=subtraction_6)
X_32 = UnitX(Factor=breite_erste_unterteilung)
X_33 = UnitX(Factor=addition_5)
move_11 = Move(Geometry=extr_5, Motion=Z_20)  # -> Geometry, Transform
move_12 = Move(Geometry=extr_6, Motion=X_31)  # -> Geometry, Transform
move_13 = Move(Geometry=item_18, Motion=X_32)  # -> Geometry, Transform
move_14 = Move(Geometry=item_19, Motion=X_33)  # -> Geometry, Transform
sdiff_2 = SolidDifference(BrepsA=[extr_6, move_12.Geometry, move_13.Geometry, move_14.Geometry], BrepsB=[extr_5, move_11.Geometry])
sunion_2 = SolidUnion(Breps=[extr_5, move_11.Geometry, sdiff_2])
X_34 = UnitX(Factor=abstand_wand_zum_ersten_fenster)
move_15 = Move(Geometry=sunion_2, Motion=X_34)  # -> Geometry, Transform
series_6 = Series(Start=0, Step=addition, Count=anzahl_fenster_2)
X_35 = UnitX(Factor=series_6)
move_16 = Move(Geometry=move_15.Geometry, Motion=X_35)  # -> Geometry, Transform
move_17 = Move(Geometry=graft(move_16.Geometry), Motion=Z_13)  # -> flatten(Geometry), Transform

move_18 = Move(Geometry=move_17.Geometry, Motion=X_24)  # -> flatten(Geometry), Transform

preview_4 = CustomPreview(Geometry=move_18.Geometry, Shader=ColourSwatch(SwatchColor=RGBA(128, 128, 128, 244)))

mirror = Mirror(Geometry=move_17.Geometry, Plane=xz)  # -> Geometry, Transform
preview_5 = CustomPreview(Geometry=mirror.Geometry, Material=ColourSwatch(SwatchColor=RGBA(128, 128, 128, 244)))

dom_9 = ConstructDomain(DomainStart=end_2.End, DomainEnd=breite_2)
rectangle_7 = Rectangle(Plane=end_2.End, XSize=dom_9, YSize=Domain(-0.01, 0.01), Radius=0)  # -> Rectangle, Length
boundary_7 = BoundarySurfaces(Edges=rectangle_7.Rectangle)
extr_7 = Extrude(Base=boundary_7, Direction=Z_12)

sdiff_3 = SolidDifference(BrepsA=extr_7, BrepsB=sunion_2)
move_19 = Move(Geometry=sdiff_3, Motion=X)  # -> Geometry, Transform
move_20 = Move(Geometry=extr_7, Motion=X)  # -> Geometry, Transform
move_21 = Move(Geometry=move_20.Geometry, Motion=X_17)  # -> Geometry, Transform

move_22 = Move(Geometry=graft(move_19.Geometry), Motion=X_17)  # -> Geometry, Transform
move_23 = Move(Geometry=graft(move_22.Geometry), Motion=Z_13)  # -> Geometry, Transform
move_24 = Move(Geometry=move_23.Geometry, Motion=X_24)  # -> flatten(Geometry), Transform

dom_10 = ConstructDomain(DomainStart=end_2.End, DomainEnd=breite)
rectangle_8 = Rectangle(Plane=end_2.End, XSize=dom_10, YSize=dom_6, Radius=0)  # -> Rectangle, Length
boundary_8 = BoundarySurfaces(Edges=rectangle_8.Rectangle)
extr_8 = Extrude(Base=boundary_8, Direction=Z_15)
sdiff_4 = SolidDifference(BrepsA=extr_8, BrepsB=sunion)
move_25 = Move(Geometry=sdiff_4, Motion=X_21)  # -> Geometry, Transform
move_26 = Move(Geometry=extr_8, Motion=X_21)  # -> Geometry, Transform
move_27 = Move(Geometry=move_26.Geometry, Motion=X_22)  # -> Geometry, Transform
move_28 = Move(Geometry=graft(move_25.Geometry), Motion=X_22)  # -> Geometry, Transform
move_29 = Move(Geometry=graft(move_28.Geometry), Motion=Z_16)  # -> Geometry, Transform
move_30 = Move(Geometry=move_27.Geometry, Motion=Z_16)  # -> Geometry, Transform
preview_6 = CustomPreview(Geometry=[move_24.Geometry, move_29.Geometry], Material=ColourSwatch(SwatchColor=RGBA(145, 186, 230, 244)))

move_31 = Move(Geometry=move_21.Geometry, Motion=Z_13)  # -> Geometry, Transform

mirror_2 = Mirror(Geometry=move_31.Geometry, Plane=xz)  # -> Geometry, Transform
preview_7 = CustomPreview(Geometry=mirror_2.Geometry, Material=ColourSwatch(SwatchColor=RGBA(145, 186, 230, 244)))

move_32 = Move(Geometry=move_31.Geometry, Motion=X_18)  # -> Geometry, Transform

trim = TrimSolid(Shape=debrep.Faces, Cutters=[move_31.Geometry, move_30.Geometry])  # -> flatten(Result)

debrep_3 = DeconstructBrep(Brep=simplify(flatten(trim)))  # -> Faces, Edges, Vertices
item_20 = ListItem(List=simplify(flatten(debrep_3.Faces)), Index=Slider(5, range=0..11), Wrap=True)
debrep_4 = DeconstructBrep(Brep=simplify(flatten(item_20)))  # -> Faces, Edges, Vertices
item_21 = ListItem(List=debrep_4.Edges, Index=Slider(1, range=0..3), Wrap=True)
len = Length(Curve=item_21)

item_22 = ListItem(List=debrep_4.Edges, Index=number_slider, Wrap=True)
curvepoint_3 = PointOnCurve(item_22, parameter=0.5)
rectangle_9 = Rectangle(Plane=curvepoint_3, XSize=Domain(-1.1, -0.1), YSize=Domain(-1.5, 1.5), Radius=0)  # -> Rectangle, Length
boundary_9 = BoundarySurfaces(Edges=rectangle_9.Rectangle)
extr_9 = Extrude(Base=boundary_9, Direction=Z_9)

# ----
# Classroom
# visualisation
debrep_5 = DeconstructBrep(Brep=trim)  # -> flatten(Faces), Edges, Vertices
Z_21 = UnitZ(Factor=0.02)
item_23 = ListItem(List=flatten(debrep_5.Faces), Index=Slider(6, range=0..11), Wrap=True)
move_33 = Move(Geometry=item_23, Motion=Z_21)  # -> Geometry, Transform
extr_10 = Extrude(Base=move_33.Geometry, Direction=Z_21)
item_24 = ListItem(List=flatten(debrep_5.Faces), Index=Slider(6, range=0..11), Wrap=True)  # -> Item, Item1
item_25 = ListItem(List=flatten(debrep_5.Faces), Index=Slider(5, range=0..11), Wrap=True)
item_26 = ListItem(List=flatten(debrep_5.Faces), Index=Slider(3, range=0..11), Wrap=True)
item_27 = ListItem(List=flatten(debrep_5.Faces), Index=Slider(8, range=0..11), Wrap=True)
preview_8 = CustomPreview(Geometry=[extr_10, move_33.Geometry], Shader=swatch)
preview_9 = CustomPreview(Geometry=item_5, Shader=swatch)
preview_10 = CustomPreview(Geometry=[item_26, item_24.Item, item_25], Shader=swatch)

rev = ReverseList(List=move_31.Geometry)
item_28 = ListItem(List=rev, Index=Slider(0, range=0..11), Wrap=True)
debrep_6 = DeconstructBrep(Brep=flatten(item_28))  # -> Faces, Edges, Vertices
item_29 = ListItem(List=debrep_6.Vertices, Index=Slider(2, range=0..11), Wrap=True)

crv_cp = CurveClosestPoint(Point=item_29, Curve=item_16)  # -> Point, Parameter, Distance
ln = Line(StartPoint=item_29, EndPoint=crv_cp.Point)
len_2 = Length(Curve=ln)

item_30 = ListItem(List=debrep_6.Vertices, Index=Slider(2, range=0..11), Wrap=True)
item_31 = ListItem(List=debrep_6.Vertices, Index=Slider(5, range=0..11), Wrap=True)
brep_cp = BrepClosestPoint(Point=item_30, Brep=item_12)  # -> Point, Normal, Distance
crv_cp_2 = CurveClosestPoint(Point=item_31, Curve=item_13)  # -> Point, Parameter, Distance
ln_2 = Line(StartPoint=item_30, EndPoint=brep_cp.Point)
ln_3 = Line(StartPoint=item_31, EndPoint=crv_cp_2.Point)
curvepoint_4 = PointOnCurve(ln_2, parameter=0.5)
len_3 = Length(Curve=ln_3)
move_34 = Move(Geometry=curvepoint_4, Motion=Y_2)  # -> Geometry, Transform
move_35 = Move(Geometry=curvepoint_4, Motion=Y_4)  # -> Geometry, Transform
ln_4 = Line(StartPoint=move_34.Geometry, EndPoint=move_35.Geometry)

python_2 = GhPythonScript(x=ist_die_rückwand_eine_außenwand, y=len_2, z=len_3)  # -> out, a, b, c, d
# ---------- python_2: Python ----------
__author__ = "lorenz"
__version__ = "2022.02.09"

import rhinoscriptsyntax as rs

if  x == 1:
    a = 0
    b = 0
    c = 0
    d = 0

if  x == 0 and y <= 0.60 and z >= 0.45:
    a = -0.55
    b = 0
    c = 1
    d = 0

if  x == 0 and y >= 0.60:
    a = -0.55
    b = 1
    c = 0
    d = 0

if  x == 0 and y <= 0.60 and z <= 0.45:
    a = -0.55
    b = 0
    c = 0
    d = 1
# ---------- end python_2 ----------
X_36 = UnitX(Factor=python_2.a)
move_36 = Move(Geometry=extr_9, Motion=X_36)  # -> Geometry, Transform
debrep_7 = DeconstructBrep(Brep=move_36.Geometry)  # -> Faces, Edges, Vertices
item_32 = ListItem(List=debrep_7.Faces, Index=Slider(2, range=0..3), Wrap=True)

preview_11 = CustomPreview(Geometry=move_36.Geometry, Shader=ColourSwatch(SwatchColor=RGB(240, 240, 240)))
multiplication = Multiplication(A=0.125, B=python_2.b)

cir = Circle(Plane=item_32, Radius=multiplication)
move_37 = Move(Geometry=cir, Motion=Y_12)  # -> Geometry, Transform
move_38 = Move(Geometry=move_37.Geometry, Motion=Z_14)  # -> Geometry, Transform
area_2 = Area(Geometry=move_38.Geometry)  # -> Area, Centroid
move_39 = Move(Geometry=area_2.Centroid, Motion=X_19)  # -> Geometry, Transform
brep_cp_2 = BrepClosestPoint(Point=move_39.Geometry, Brep=item_15)  # -> Point, Normal, Distance
ln_5 = Line(StartPoint=area_2.Centroid, EndPoint=move_39.Geometry)
ln_6 = Line(StartPoint=move_39.Geometry, EndPoint=brep_cp_2.Point)
join = JoinCurves(Curves=[ln_5, ln_6], Preserve=False)
fillet = Fillet(Curve=join, Radius=0.25)
swp1 = Sweep1(Rail=fillet, Sections=move_38.Geometry, Miter=1)

move_40 = Move(Geometry=brep_cp_2.Point, Motion=Y)  # -> Geometry, Transform
brep_cp_3 = BrepClosestPoint(Point=move_40.Geometry, Brep=item_10)  # -> Point, Normal, Distance
ln_7 = Line(StartPoint=move_40.Geometry, EndPoint=brep_cp_3.Point)
crv_cp_3 = CurveClosestPoint(Point=item_29, Curve=ln_7)  # -> Point, Parameter, Distance
ln_8 = Line(StartPoint=crv_cp_3.Point, EndPoint=brep_cp_3.Point)
curvepoint_5 = PointOnCurve(ln_8, parameter=0.5)
brep_cp_4 = BrepClosestPoint(Point=curvepoint_5, Brep=item_11)  # -> Point, Normal, Distance
ln_9 = Line(StartPoint=brep_cp_4.Point, EndPoint=curvepoint_5)
ln_10 = Line(StartPoint=move_40.Geometry, EndPoint=move_39.Geometry)
ln_11 = Line(StartPoint=curvepoint_5, EndPoint=move_40.Geometry)
ln_12 = Line(StartPoint=move_39.Geometry, EndPoint=area_2.Centroid)
join_2 = JoinCurves(Curves=[ln_9, ln_11, ln_10, ln_12], Preserve=False)
fillet_2 = Fillet(Curve=join_2, Radius=0.25)
swp1_2 = Sweep1(Rail=fillet_2, Sections=move_38.Geometry, Miter=1)

move_41 = Move(Geometry=cir, Motion=Y_11)  # -> Geometry, Transform
move_42 = Move(Geometry=move_41.Geometry, Motion=Z_10)  # -> Geometry, Transform
area_3 = Area(Geometry=move_42.Geometry)  # -> Area, Centroid
move_43 = Move(Geometry=area_3.Centroid, Motion=X_16)  # -> Geometry, Transform
brep_cp_5 = BrepClosestPoint(Point=move_43.Geometry, Brep=item_7)  # -> Point, Normal, Distance
ln_13 = Line(StartPoint=area_3.Centroid, EndPoint=move_43.Geometry)
ln_14 = Line(StartPoint=move_43.Geometry, EndPoint=brep_cp_5.Point)
join_3 = JoinCurves(Curves=[ln_13, ln_14], Preserve=False)
fillet_3 = Fillet(Curve=join_3, Radius=0.005)
swp1_3 = Sweep1(Rail=fillet_3, Sections=move_42.Geometry, Miter=1)

move_44 = Move(Geometry=swp1, Motion=Y_13)  # -> Geometry, Transform
move_45 = Move(Geometry=move_44.Geometry, Motion=X_20)  # -> Geometry, Transform
sdiff_5 = SolidDifference(BrepsA=move_45.Geometry, BrepsB=item_15)
sdiff_6 = SolidDifference(BrepsA=move_45.Geometry, BrepsB=sdiff_5)
sdiff_7 = SolidDifference(BrepsA=sdiff_6, BrepsB=item_32)
capex = CapHolesEx(Brep=sdiff_7)  # -> Brep, Caps, Solid

multiplication_2 = Multiplication(A=0.125, B=python_2.d)
cir_2 = Circle(Plane=item_32, Radius=multiplication_2)
move_46 = Move(Geometry=cir_2, Motion=Y_3)  # -> Geometry, Transform
move_47 = Move(Geometry=move_46.Geometry, Motion=Z_4)  # -> Geometry, Transform
area_4 = Area(Geometry=move_47.Geometry)  # -> Area, Centroid
move_48 = Move(Geometry=area_4.Centroid, Motion=X_2)  # -> Geometry, Transform
brep_cp_6 = BrepClosestPoint(Point=move_48.Geometry, Brep=item_14)  # -> Point, Normal, Distance
ln_15 = Line(StartPoint=area_4.Centroid, EndPoint=move_48.Geometry)
move_49 = Move(Geometry=brep_cp_6.Point, Motion=Y_2)  # -> Geometry, Transform
ln_16 = Line(StartPoint=move_48.Geometry, EndPoint=move_49.Geometry)
ln_17 = Line(StartPoint=move_49.Geometry, EndPoint=move_34.Geometry)
join_4 = JoinCurves(Curves=[ln_15, ln_16, ln_17, ln_4], Preserve=False)
join_5 = JoinCurves(Curves=[ln_17, ln_4], Preserve=False)
join_6 = JoinCurves(Curves=[join_4, join_5], Preserve=False)
fillet_4 = Fillet(Curve=join_6, Radius=0.25)
swp1_4 = Sweep1(Rail=fillet_4, Sections=move_47.Geometry, Miter=1)
sdiff_8 = SolidDifference(BrepsA=swp1_4, BrepsB=item_14)
cap = CapHoles(Brep=sdiff_8)

move_50 = Move(Geometry=ln_15, Motion=Y_5)  # -> Geometry, Transform
move_51 = Move(Geometry=ln_16, Motion=Y_6)  # -> Geometry, Transform
move_52 = Move(Geometry=move_47.Geometry, Motion=Y_7)  # -> Geometry, Transform
move_53 = Move(Geometry=ln_15, Motion=Y_8)  # -> Geometry, Transform
move_54 = Move(Geometry=move_50.Geometry, Motion=X_3)  # -> Geometry, Transform
move_55 = Move(Geometry=move_51.Geometry, Motion=X_4)  # -> Geometry, Transform
move_56 = Move(Geometry=move_52.Geometry, Motion=X_5)  # -> Geometry, Transform
move_57 = Move(Geometry=move_53.Geometry, Motion=X_6)  # -> Geometry, Transform
scx = SurfaceCurve(Surface=item_32, Curve=move_54.Geometry)  # -> Curves, Points, UVPoints, Normals, Parameters, Tangents
end_3 = EndPoints(Curve=move_57.Geometry)  # -> Start, End
scx_2 = SurfaceCurve(Surface=item_7, Curve=move_55.Geometry)  # -> Curves, Points, UVPoints, Normals, Parameters, Tangents
move_58 = Move(Geometry=scx_2.Points, Motion=Y_9)  # -> Geometry, Transform
end_4 = EndPoints(Curve=move_55.Geometry)  # -> Start, End
brep_cp_7 = BrepClosestPoint(Point=move_58.Geometry, Brep=item_12)  # -> Point, Normal, Distance
ln_18 = Line(StartPoint=move_58.Geometry, EndPoint=end_4.Start)
move_59 = Move(Geometry=move_58.Geometry, Motion=X_7)  # -> Geometry, Transform
ln_19 = Line(StartPoint=move_58.Geometry, EndPoint=brep_cp_7.Point)
brep_cp_8 = BrepClosestPoint(Point=move_59.Geometry, Brep=item_7)  # -> Point, Normal, Distance
crv_cp_4 = CurveClosestPoint(Point=move_34.Geometry, Curve=ln_19)  # -> Point, Parameter, Distance
ln_20 = Line(StartPoint=end_4.Start, EndPoint=move_58.Geometry)
ln_21 = Line(StartPoint=end_3.Start, EndPoint=end_3.End)
ln_22 = Line(StartPoint=move_58.Geometry, EndPoint=crv_cp_4.Point)
move_60 = Move(Geometry=crv_cp_4.Point, Motion=X_8)  # -> Geometry, Transform
ln_23 = Line(StartPoint=crv_cp_4.Point, EndPoint=move_60.Geometry)
end_5 = EndPoints(Curve=ln_23)  # -> Start, End
join_7 = JoinCurves(Curves=[ln_20, ln_21], Preserve=False)
join_8 = JoinCurves(Curves=[join_7, ln_22], Preserve=False)
move_61 = Move(Geometry=move_60.Geometry, Motion=Y_10)  # -> Geometry, Transform
ln_24 = Line(StartPoint=move_60.Geometry, EndPoint=move_61.Geometry)
yz_2 = YZPlane(Origin=end_5.Start)
join_9 = JoinCurves(Curves=[join_8, ln_23], Preserve=False)
cir_3 = Circle(Plane=yz_2, Radius=multiplication_2)
xz_2 = XZPlane(Origin=end_5.Start)
join_10 = JoinCurves(Curves=flatten([join_9, ln_24]), Preserve=False)
join_11 = JoinCurves(Curves=join_10, Preserve=False)
fillet_5 = Fillet(Curve=flatten(join_11), Radius=0.25)
swp1_5 = Sweep1(Rail=fillet_5, Sections=move_56.Geometry, Miter=1)
sdiff_9 = SolidDifference(BrepsA=swp1_5, BrepsB=item_14)
sdiff_10 = SolidDifference(BrepsA=swp1_5, BrepsB=sdiff_9)
cap_2 = CapHoles(Brep=sdiff_10)

addition_6 = Addition(A=-1.1, B=python_2.a)
dom_11 = ConstructDomain(DomainStart=0, DomainEnd=addition_6)
rectangle_10 = Rectangle(Plane=curvepoint_3, XSize=dom_11, YSize=Domain(-1.5, 1.5), Radius=0)  # -> Rectangle, Length
boundary_10 = BoundarySurfaces(Edges=rectangle_10.Rectangle)
rdiff = RegionDifference(CurvesA=item_20, CurvesB=boundary_10)

division = Division(A=len, B=2)
multiplication_3 = Multiplication(A=division, B=-1)
addition_7 = Addition(A=-1.1, B=python_2.a)
dom_12 = ConstructDomain(DomainStart=multiplication_3, DomainEnd=division)
dom_13 = ConstructDomain(DomainStart=addition_7, DomainEnd=0)
rectangle_11 = Rectangle(Plane=curvepoint_3, XSize=dom_13, YSize=dom_12, Radius=0)  # -> Rectangle, Length
boundary_11 = BoundarySurfaces(Edges=rectangle_11.Rectangle)
rdiff_2 = RegionDifference(CurvesA=item_20, CurvesB=boundary_11)

multiplication_4 = Multiplication(A=0.125, B=python_2.c)
cir_4 = Circle(Plane=item_32, Radius=multiplication_4)
move_62 = Move(Geometry=cir_4, Motion=Y_14)  # -> Geometry, Transform
move_63 = Move(Geometry=move_62.Geometry, Motion=Z_17)  # -> Geometry, Transform
area_5 = Area(Geometry=move_63.Geometry)  # -> Area, Centroid
move_64 = Move(Geometry=area_5.Centroid, Motion=X_23)  # -> Geometry, Transform
ln_25 = Line(StartPoint=area_5.Centroid, EndPoint=move_64.Geometry)
brep_cp_9 = BrepClosestPoint(Point=move_64.Geometry, Brep=item_17)  # -> Point, Normal, Distance
ln_26 = Line(StartPoint=move_64.Geometry, EndPoint=brep_cp_9.Point)
join_12 = JoinCurves(Curves=[ln_25, ln_26], Preserve=False)
fillet_6 = Fillet(Curve=join_12, Radius=0.25)
swp1_6 = Sweep1(Rail=fillet_6, Sections=move_63.Geometry, Miter=1)

debrep_8 = DeconstructBrep(Brep=rdiff_2)  # -> Faces, Edges, Vertices
item_33 = ListItem(List=debrep_8.Edges, Index=Slider(2, range=0..3), Wrap=True)
item_34 = ListItem(List=debrep_8.Edges, Index=Slider(0, range=0..3), Wrap=True)
item_35 = ListItem(List=debrep_8.Edges, Index=Slider(1, range=0..3), Wrap=True)
len_4 = Length(Curve=item_35)
curvepoint_6 = PointOnCurve(item_33, parameter=0)
division_2 = Division(A=len_4, B=0.625)
rectangle_12 = Rectangle(Plane=curvepoint_6, XSize=Domain(0, -0.625), YSize=Domain(0, 0.625), Radius=0)  # -> Rectangle, Length
round = Round(Number=division_2)  # -> Nearest, Floor, Ceiling
series_7 = Series(Start=0, Step=0.625, Count=round.Ceiling)
X_37 = UnitX(Factor=series_7)
multiplication_5 = Multiplication(A=X_37, B=-1)
division_3 = Division(A=round.Floor, B=4)
division_4 = Division(A=round.Floor, B=3)
move_65 = Move(Geometry=rectangle_12.Rectangle, Motion=multiplication_5)  # -> Geometry, Transform
round_2 = Round(Number=division_3)  # -> Nearest, Floor, Ceiling
round_3 = Round(Number=division_4)  # -> Nearest, Floor, Ceiling
addition_8 = Addition(A=round_3.Floor, B=1)
addition_9 = Addition(A=round_2.Floor, B=1)

move_66 = Move(Geometry=ln_25, Motion=Y_15)  # -> Geometry, Transform
move_67 = Move(Geometry=ln_26, Motion=Y_16)  # -> Geometry, Transform
move_68 = Move(Geometry=move_63.Geometry, Motion=Y_17)  # -> Geometry, Transform
move_69 = Move(Geometry=ln_25, Motion=Y_18)  # -> Geometry, Transform
move_70 = Move(Geometry=move_66.Geometry, Motion=X_25)  # -> Geometry, Transform
move_71 = Move(Geometry=move_67.Geometry, Motion=X_26)  # -> Geometry, Transform
move_72 = Move(Geometry=move_68.Geometry, Motion=X_27)  # -> Geometry, Transform
move_73 = Move(Geometry=move_69.Geometry, Motion=X_28)  # -> Geometry, Transform
scx_3 = SurfaceCurve(Surface=item_32, Curve=move_70.Geometry)  # -> Curves, Points, UVPoints, Normals, Parameters, Tangents
scx_4 = SurfaceCurve(Surface=item_7, Curve=move_71.Geometry)  # -> Curves, Points, UVPoints, Normals, Parameters, Tangents
end_6 = EndPoints(Curve=move_73.Geometry)  # -> Start, End
move_74 = Move(Geometry=scx_4.Points, Motion=Y_19)  # -> Geometry, Transform
move_75 = Move(Geometry=move_74.Geometry, Motion=X_29)  # -> Geometry, Transform
end_7 = EndPoints(Curve=move_71.Geometry)  # -> Start, End
brep_cp_10 = BrepClosestPoint(Point=move_75.Geometry, Brep=item_7)  # -> Point, Normal, Distance
ln_27 = Line(StartPoint=brep_cp_10.Point, EndPoint=move_75.Geometry)
ln_28 = Line(StartPoint=move_75.Geometry, EndPoint=move_74.Geometry)
ln_29 = Line(StartPoint=move_74.Geometry, EndPoint=end_7.Start)
ln_30 = Line(StartPoint=end_6.End, EndPoint=end_6.Start)
join_13 = JoinCurves(Curves=[ln_29, ln_30], Preserve=False)
join_14 = JoinCurves(Curves=[ln_27, ln_28], Preserve=False)
join_15 = JoinCurves(Curves=[join_14, join_13], Preserve=False)
fillet_7 = Fillet(Curve=join_15, Radius=join_15)
swp1_7 = Sweep1(Rail=fillet_7, Sections=move_72.Geometry, Miter=1)
sdiff_11 = SolidDifference(BrepsA=swp1_7, BrepsB=item_32)  # -> flatten(Result)

preview_12 = CustomPreview(Geometry=[cap, cap_2, sdiff_11, swp1_6, swp1_2, capex.Brep], Shader=ColourSwatch(SwatchColor=RGB(128, 128, 128)))

multiplication_6 = Multiplication(A=0.625, B=3)
series_8 = Series(Start=0, Step=multiplication_6, Count=addition_8)
X_38 = UnitX(Factor=series_8)
multiplication_7 = Multiplication(A=X_38, B=-1)
move_76 = Move(Geometry=rectangle_12.Rectangle, Motion=multiplication_7)  # -> Geometry, Transform
debrep_9 = DeconstructBrep(Brep=move_76.Geometry)  # -> Faces, Edges, Vertices
rev_2 = ReverseList(List=flatten(debrep_9.Faces))
item_36 = ListItem(List=flatten(rev_2), Index=Slider(0, range=0..3), Wrap=True)
debrep_10 = DeconstructBrep(Brep=item_36)  # -> Faces, Edges, Vertices
item_37 = ListItem(List=flatten(debrep_10.Vertices), Index=Slider(0, range=0..3), Wrap=True)

debrep_11 = DeconstructBrep(Brep=rdiff)  # -> Faces, Edges, Vertices
item_38 = ListItem(List=debrep_11.Edges, Index=Slider(1, range=0..3), Wrap=True)
item_39 = ListItem(List=debrep_11.Edges, Index=Slider(0, range=0..3), Wrap=True)
len_5 = Length(Curve=item_39)
len_6 = Length(Curve=item_38)
division_5 = Division(A=len_5, B=0.625)
division_6 = Division(A=len_6, B=0.625)
addition_10 = Addition(A=division_6, B=1)
addition_11 = Addition(A=division_5, B=1)
recgrid = Rectangular(Plane=rdiff, SizeX=0.625, SizeY=0.625, ExtentX=addition_11, ExtentY=addition_10)  # -> flatten(Cells), Points

item_40 = ListItem(List=debrep_8.Edges, Index=Slider(3, range=0..3), Wrap=True)
len_7 = Length(Curve=item_33)
division_7 = Division(A=len_7, B=0.625)
rdiff_3 = RegionDifference(CurvesA=move_65.Geometry, CurvesB=rdiff_2)
rdiff_4 = RegionDifference(CurvesA=move_65.Geometry, CurvesB=rdiff_3)

multiplication_8 = Multiplication(A=0.625, B=4)
series_9 = Series(Start=0, Step=multiplication_8, Count=addition_9)
X_39 = UnitX(Factor=series_9)
multiplication_9 = Multiplication(A=X_39, B=-1)
move_77 = Move(Geometry=rectangle_12.Rectangle, Motion=multiplication_9)  # -> Geometry, Transform
debrep_12 = DeconstructBrep(Brep=move_77.Geometry)  # -> Faces, Edges, Vertices

rev_3 = ReverseList(List=flatten(debrep_12.Faces))

item_41 = ListItem(List=flatten(rev_3), Index=Slider(0, range=0..3), Wrap=True)
debrep_13 = DeconstructBrep(Brep=item_41)  # -> Faces, Edges, Vertices
item_42 = ListItem(List=flatten(debrep_13.Vertices), Index=Slider(0, range=0..3), Wrap=True)

crv_cp_5 = CurveClosestPoint(Point=item_42, Curve=item_34)  # -> Point, Parameter, Distance
crv_cp_6 = CurveClosestPoint(Point=item_37, Curve=item_34)  # -> Point, Parameter, Distance
python_3 = GhPythonScript(x=crv_cp_5.Distance, y=crv_cp_6.Distance, z=addition_9, u=addition_8)  # -> out, a, b
# ---------- python_3: Python ----------
__author__ = "lorenz"
__version__ = "2022.02.09"

import rhinoscriptsyntax as rs

if  x < y and x >= 0.625 and y < 1.5:
    a = 3
    b = u

if  x < y and x >= 0.625 and y >= 1.5:
    a = 4
    b = z

elif y < x and y >= 0.625 and x < 1.5:
    a = 4
    b = z

elif y < x and y >= 0.625 and x >= 1.5:
    a = 3
    b = u

elif x == y and y >= 0.625:
    a = 4
    b = z

elif x < 0.625 and y >= 0.625:
    a = 3
    b = u

elif y < 0.625 and x >= 0.625:
    a = 4
    b = z

else:
    a = 3
    b = u -1
# ---------- end python_3 ----------

division_8 = Division(A=division_7, B=python_3.a)
round_4 = Round(Number=division_8)  # -> Nearest, Floor, Ceiling
multiplication_10 = Multiplication(A=round_4.Floor, B=python_3.a)
addition_12 = Addition(A=multiplication_10, B=1)
series_10 = Series(Start=0, Step=0.625, Count=addition_12)
Y_20 = UnitY(Factor=series_10)
move_78 = Move(Geometry=graft(rdiff_4), Motion=Y_20)  # -> Geometry, Transform
debrep_14 = DeconstructBrep(Brep=move_78.Geometry)  # -> Faces, Edges, Vertices
rev_4 = ReverseList(List=flatten(debrep_14.Vertices))
item_43 = ListItem(List=flatten(rev_4), Index=Slider(0, range=0..3), Wrap=True)
crv_cp_7 = CurveClosestPoint(Point=item_43, Curve=item_40)  # -> Point, Parameter, Distance
division_9 = Division(A=crv_cp_7.Distance, B=2)
Y_21 = UnitY(Factor=division_9)

round_5 = Round(Number=division_8)  # -> Nearest, Floor, Ceiling
multiplication_11 = Multiplication(A=round_5.Floor, B=python_3.a)
addition_13 = Addition(A=multiplication_11, B=1)
subtraction_7 = Subtraction(A=addition_13, B=python_3.a)
series_11 = Series(Start=0, Step=0.625, Count=subtraction_7)
Y_22 = UnitY(Factor=series_11)
move_79 = Move(Geometry=graft(rdiff_4), Motion=Y_22)  # -> Geometry, Transform
debrep_15 = DeconstructBrep(Brep=move_79.Geometry)  # -> Faces, Edges, Vertices
rev_5 = ReverseList(List=flatten(debrep_15.Vertices))
item_44 = ListItem(List=flatten(rev_5), Index=Slider(0, range=0..3), Wrap=True)
crv_cp_8 = CurveClosestPoint(Point=item_44, Curve=item_40)  # -> Point, Parameter, Distance
division_10 = Division(A=crv_cp_8.Distance, B=2)
Y_23 = UnitY(Factor=division_10)

multiplication_12 = Multiplication(A=0.625, B=python_3.a)
series_12 = Series(Start=0, Step=multiplication_12, Count=python_3.b)
X_40 = UnitX(Factor=series_12)
multiplication_13 = Multiplication(A=X_40, B=-1)
move_80 = Move(Geometry=rectangle_12.Rectangle, Motion=multiplication_13)  # -> Geometry, Transform

python_4 = GhPythonScript(x=division_10, y=division_9, z=python_3.a, u=addition_9, v=addition_8, w=python_3.b)  # -> out, a, b, c
# ---------- python_4: Python ----------
__author__ = "lorenz"
__version__ = "2022.02.09"

import rhinoscriptsyntax as rs

if  x <= 1.4 and y < 0.70 and z == 4:
    a = z
    b = w
    c = z

if  x > 1.4 and y < 0.70 and z == 4:
    a = 3
    b = v
    c = 0

if  x <= 1.4 and y < 0.70 and z == 3:
    a = z
    b = w
    c = z

else:
    a = z
    b = w
    c = 0
# ---------- end python_4 ----------

division_11 = Division(A=division_7, B=python_4.a)
round_6 = Round(Number=division_11)  # -> Nearest, Floor, Ceiling
multiplication_14 = Multiplication(A=round_6.Floor, B=python_3.a)
addition_14 = Addition(A=multiplication_14, B=1)
subtraction_8 = Subtraction(A=addition_14, B=python_4.c)
series_13 = Series(Start=0, Step=0.625, Count=subtraction_8)
Y_24 = UnitY(Factor=series_13)
move_81 = Move(Geometry=graft(rdiff_4), Motion=Y_24)  # -> Geometry, Transform
debrep_16 = DeconstructBrep(Brep=move_81.Geometry)  # -> Faces, Edges, Vertices
rev_6 = ReverseList(List=flatten(debrep_16.Vertices))
item_45 = ListItem(List=flatten(rev_6), Index=Slider(0, range=0..3), Wrap=True)
crv_cp_9 = CurveClosestPoint(Point=item_45, Curve=item_40)  # -> Point, Parameter, Distance
division_12 = Division(A=crv_cp_9.Distance, B=2)
Y_25 = UnitY(Factor=division_12)
move_82 = Move(Geometry=move_81.Geometry, Motion=Y_25)  # -> Geometry, Transform
runion = RegionUnion(Curves=flatten(move_82.Geometry))
debrep_17 = DeconstructBrep(Brep=runion)  # -> Faces, Edges, Vertices
item_46 = ListItem(List=flatten(debrep_17.Edges), Index=Slider(0, range=0..3), Wrap=True)
len_8 = Length(Curve=item_46)
division_13 = Division(A=len_8, B=0.625)
division_14 = Division(A=division_13, B=python_4.a)
addition_15 = Addition(A=division_14, B=1)
round_7 = Round(Number=addition_15)  # -> Nearest, Floor, Ceiling

debrep_18 = DeconstructBrep(Brep=move_82.Geometry)  # -> Faces, Edges, Vertices
cps = ClosestPoints(Point=recgrid.Points, Cloud=debrep_18.Vertices, Count=3)  # -> ClosestPoint, CPIndex, simplify(Distance)
devec = DeconstructVector(Vector=flatten(cps.ClosestPoint))  # -> XComponent, YComponent, ZComponent
larger = LargerThan(FirstNumber=devec.YComponent, SecondNumber=0.005)  # -> LargerThan, OrEqualTo
larger_2 = LargerThan(FirstNumber=devec.XComponent, SecondNumber=0.005)  # -> LargerThan, OrEqualTo
cull = CullPattern(List=devec.YComponent, CullPattern=larger.OrEqualTo)
cull_2 = CullPattern(List=devec.XComponent, CullPattern=larger_2.OrEqualTo)
sort = SortList(Keys=cull)  # -> Keys, ValuesA
sort_2 = SortList(Keys=cull_2)  # -> Keys, ValuesA
item_47 = ListItem(List=sort.Keys, Index=0, Wrap=True)
item_48 = ListItem(List=sort_2.Keys, Index=0, Wrap=True)
X_41 = UnitX(Factor=item_48)
move_83 = Move(Geometry=recgrid.Cells, Motion=X_41)  # -> Geometry, Transform
Y_26 = UnitY(Factor=item_47)
move_84 = Move(Geometry=move_83.Geometry, Motion=Y_26)  # -> Geometry, Transform

multiplication_15 = Multiplication(A=0.625, B=python_4.a)
series_14 = Series(Start=0, Step=multiplication_15, Count=python_4.b)
X_42 = UnitX(Factor=series_14)
multiplication_16 = Multiplication(A=X_42, B=-1)
move_85 = Move(Geometry=rectangle_12.Rectangle, Motion=multiplication_16)  # -> Geometry, Transform

sunion_3 = SolidUnion(Breps=flatten(move_82.Geometry))
boundary_12 = BoundarySurfaces(Edges=flatten(sunion_3))
Z_22 = UnitZ(Factor=-0.4)
extr_11 = Extrude(Base=boundary_12, Direction=Z_9)
move_86 = Move(Geometry=move_82.Geometry, Motion=Z_22)  # -> Geometry, Transform
Z_23 = UnitZ(Factor=-0.01)
preview_13 = CustomPreview(Geometry=move_86.Geometry, Shader=ColourSwatch(SwatchColor=RGB(5, 8, 4)))
move_87 = Move(Geometry=extr_11, Motion=Z_23)  # -> Geometry, Transform
srf = Surface(move_86.Geometry)
preview_14 = CustomPreview(Geometry=move_87.Geometry, Shader=ColourSwatch(SwatchColor=RGBA(230, 230, 230, 177)))
preview_15 = CustomPreview(Geometry=srf, Material=ColourSwatch(SwatchColor=RGBA(255, 251, 245, 241)))

multiplication_17 = Multiplication(A=0.625, B=python_4.a)
series_15 = Series(Start=0, Step=multiplication_17, Count=round_7.Floor)
move_88 = Move(Geometry=move_85.Geometry, Motion=Y_25)  # -> graft(Geometry), Transform
Y_27 = UnitY(Factor=series_15)
move_89 = Move(Geometry=move_88.Geometry, Motion=Y_27)  # -> Geometry, Transform
Z_24 = UnitZ(Factor=-0.0001)

move_90 = Move(Geometry=move_89.Geometry, Motion=Z_2)  # -> Geometry, Transform
move_91 = Move(Geometry=move_90.Geometry, Motion=Z_24)  # -> Geometry, Transform
srf_2 = Surface(move_91.Geometry)

preview_16 = CustomPreview(Geometry=srf_2, Material=ColourSwatch(SwatchColor=RGB(240, 229, 22)))

# ----
# Lighting: wallwasher
number_slider_3 = Slider(0, range=0..3)
python_5 = GhPythonScript()  # -> out, a, b
# ---------- python_5: Python ----------
__author__ = "lorenz"
__version__ = "2022.02.09"

import rhinoscriptsyntax as rs

if  x > 1.8:
    a = 0
    b = -0.13

elif x == 1.8:
    a = 0
    b = -0.13

else:
    a = 0
    b = 0
# ---------- end python_5 ----------
python_6 = GhPythonScript()  # -> out, a, b
# ---------- python_6: Python ----------
__author__ = "lorenz"
__version__ = "2022.02.09"

import rhinoscriptsyntax as rs

if  x > 1.8:
    a = -1.8
    b = 1.8

elif x == 1.8:
    a = -1.8
    b = 1.8

else:
    a = 0
    b = 0
# ---------- end python_6 ----------
item_49 = ListItem(Index=number_slider_3, Wrap=True)
curvepoint_7 = PointOnCurve(item_49, parameter=0.5)
python_7 = GhPythonScript(x=python_6.b)  # -> out, simplify(a), simplify(b), simplify(c), simplify(d)
# ---------- python_7: Python ----------
__author__ = "lorenz"
__version__ = "2022.02.09"

import rhinoscriptsyntax as rs

if  x == 0:
    a = None
    b = None
    c = None
    d = 0

else:
    a = 1.2
    b = 0.13
    c = 0.06
    d = 3
# ---------- end python_7 ----------
dom_14 = ConstructDomain(DomainStart=python_5.a, DomainEnd=python_5.b)
dom_15 = ConstructDomain(DomainStart=python_6.a, DomainEnd=python_6.b)
rectangle_13 = Rectangle(Plane=curvepoint_7, XSize=dom_14, YSize=dom_15, Radius=0)  # -> Rectangle, Length
addition_16 = Addition(A=1.26)
boundary_13 = BoundarySurfaces(Edges=rectangle_13.Rectangle)
X_43 = UnitX(Factor=addition_16)
Z_25 = UnitZ(Factor=-0.061)
extr_12 = Extrude(Base=boundary_13, Direction=Z_25)
move_92 = Move(Geometry=extr_12, Motion=X_43)  # -> Geometry, Transform

move_93 = Move(Geometry=move_92.Geometry, Motion=Z_3)  # -> Geometry, Transform

preview_17 = CustomPreview(Geometry=move_93.Geometry, Material=ColourSwatch(SwatchColor=RGBA(240, 229, 22, 244)))
